# Grasshopper definition HeatLossGain.gh (Grasshopper 0.9.76)
# plug-ins: Python Interpreter

number_slider = Slider(10, range=0..20)
# This example file is made 2017.09.20 21.42
panel = Panel("Calculating Heat Loss/Gain")
srf = Surface(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)

# ---- group: lots of geo
divide = DivideDomain²(Domain=srf, UCount=number_slider, VCount=number_slider)
subsrf = Isotrim(Surface=srf, Domain=divide)

# ----
panel_2 = Panel("(W),(W/m2K),(m2),(K)")
panel_3 = Panel("Q = (U) (A) (∆T)")
panel_4 = Panel("Ventilation")
panel_5 = Panel("Infiltration")
panel_6 = Panel("Radiation")
panel_7 = Panel("Transmission")
livestock_heat_transmission = Livestock_Heat_Transmission(Geo=subsrf, U=Slider(0.484, range=0.1..1.1), Ti=Slider(19, range=0..35), To=Slider(-12, range=-30..35))  # -> out, Q, Qi; inputs Geo: list, U: list
# ---------- livestock_heat_transmission: Python ----------
"""
Livestock Heat transfer - Transmission. Calculates the transmission losses and gains of various geometries under stationary conditions
-----
Please notice only type of geometry type is allowed as input 
-----
LIVESTOCK made by Kristoffer Negendahl, DTU.BYG

    Args:
        Geo: List of Surfaces, Breps or Meshes
        U: List of U-values [W/(m2K)] for each Geometry (if only one U, all Geometries will be evaluated on the single U-value)
        Ti: Temperature (C) on the inner side of the geometry (20C is set as default)
        To: Temperature (C) on the outside of the geometry (-12C is set as default)
    Returns:
        Q: Output the transmission heat balance [kW] - if negative the transmission is considered as a loss from inside to the outside, and if positive the transmission is a gain from outside to the inside
        Qi: Output the individual geometry transmission heat balance [W]
"""

# Add the message thingie underneath the component
ghenv.Component.Name = 'Livestock_Heat_Transmission'
ghenv.Component.NickName = 'Livestock Heat Transmission'
ghenv.Component.Message = 'Transmission v.0.1'

# Importing classes and modules
import Rhino as rc

# Setting defaults 

U_def = [0]
Ti_def = 20
To_def = -12

### Ordering inputs into dedicated lists
## Supports three types of geometry 
srfs = []
breps = []
meshes = []

for g in Geo:
    #print type(g)
    if isinstance(g,rc.Geometry.Surface): #is surface
        #print("a surface")
        srfs.append(g)
    elif isinstance(g,rc.Geometry.Brep): #is Brep
        #print("a brep")
        breps.append(g)
    elif isinstance(g,rc.Geometry.Mesh): #is Mesh
        #print("a mesh")
        meshes.append(g)
    else:
        print("not a geometry I can work with")

# Output relevant information
noSrfs = str(len(srfs))
noBreps = str(len(breps))
noMeshes = str(len(meshes))

print "Transmission from {} surfaces,".format(noSrfs), "{} breps,".format(noBreps), "{} meshes".format(noMeshes)

# Function that calucalates an area of a geometry
def area(list_of_geometry):
    area = []
    areaerror = []
    #try: # -- can't use this - only works on breps and srfs
        #for i in range(len(list_of_geometry)):
            #area.append(list_of_geometry[i].GetArea())
    #except:
        #print "Geometry had no GetArea properties"
    try:
        for i in range(len(list_of_geometry)):
            area.append(rc.Geometry.AreaMassProperties.Compute(list_of_geometry[i]).Area)
            areaerror.append(rc.Geometry.AreaMassProperties.Compute(list_of_geometry[i]).AreaError)
    except:
        print "Geometry had no AreaMassProperties properties"
    #print(areaerror)
    return area

# Function that calculates the transmission balance
def transm(areas, Uvals, ti, to):
    qli = []
    if len(areas) > 1 and len(areas) == len(Uvals): #when multiple Uvals
        for i in range(len(areas)):
            qli.append(areas[i]*Uvals[i]*(to-ti))
    else: #when only one Uval
        for i in range(len(areas)):
            qli.append(areas[i]*Uvals[0]*(to-ti))
    Qi = qli
    Q = round(sum(qli)/1000,2)
    return Q, Qi

# Setting defaults if nothing else is assigned 
if not U:
    U = U_def
if not Ti:
    Ti = Ti_def
if not To:
    To = To_def


# Check geometry lists and assign area function

if srfs:
    try: A = area(srfs)
    except: print("not a geometry I can work with")
elif breps:
    try: A = area(breps)
    except: print("not a geometry I can work with")
elif meshes:
    try: A = area(meshes)
    except: print("not a geometry I can work with")

# Calculate heat transmission

Transmission = transm(A, U, Ti, To)
Q = Transmission[0]
Qi = Transmission[1]
# ---------- end livestock_heat_transmission ----------
srftorecolormesh = SurfaceToRecolorMesh(inputsrf=subsrf, inputnum=livestock_heat_transmission.Qi, min="-100", max="-50")  # disabled

# ==== cluster SurfaceToRecolorMesh
inputsrf = ClusterInput()
inputsrf_2 = Surface(inputsrf)
inputnum = ClusterInput()
max = ClusterInput()
min = ClusterInput()
inputnum_2 = Number(inputnum)

# ---- group: Mesh to recolor
mesh = Mesh(inputsrf_2)

# ---- group: Some value
num = Number(inputnum_2)

# ----
max_2 = Number(max)
min_2 = Number(min)
dom = ConstructDomain(DomainStart=min_2, DomainEnd=max_2)
dedomain = DeconstructDomain(Domain=dom)  # -> Start, End
gradient = Gradient(
    LowerLimit=dedomain.Start,
    UpperLimit=dedomain.End,
    Parameter=num,
    stops=[0: RGB(202, 0, 0), 0.25: RGB(255, 15, 0), 0.5: RGB(254, 255, 255), 0.75: RGB(173, 203, 249), 1: RGB(0, 0, 169)])
mcol = MeshColours(Mesh=graft(mesh), Colours=graft(gradient))
mjoin = MeshJoin(Meshes=flatten(mcol))
weld = WeldMesh(Mesh=mjoin, Angle=3.141592654)

# ---- group: Final recolored mesh based on some value
mesh_2 = Mesh(weld)

# ----
outputmesh = Mesh(mesh_2)
outputmesh_2 = ClusterOutput(outputmesh)
