# Grasshopper definition data_management.gh (Grasshopper 0.9.76)
# plug-ins: Python Interpreter

ladybug = Ladybug_Ladybug()  # -> Vviiiiiiiiiizzz; plug-in component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
gismo = Gismo_Gismo(gismoFolder="c:\gismo")  # -> readMe; plug-in component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
# "Tips on data management"
# 
# 2017.10.04
# Kristoffer Negendahl
toggle = BooleanToggle(True)

# ---- group: read csv in various ways, can take larger amounts of data and can be dynamically read
python = PythonScript(importCSV=toggle)  # -> points
# ---------- python: Python ----------
# Import points from a text file
import rhinoscriptsyntax as rs


def ImportPoints():
    #prompt the user for a file to import
    filter = "Text file (*.csv)|*.csv|All Files (*.*)|*.*||"
    filename = rs.OpenFileName("Open CSV formatted Point File", filter)
    if not filename: return
    
    #read each line from the file
    file = open(filename, "r")
    contents = file.readlines()
    file.close()

    # local helper function    
    def point_from_string(text):
        items = text.strip("()\n").split(",")
        x = float(items[0])
        y = float(items[1])
        z = float(items[2])
        return x, y, z

    contents = [point_from_string(line) for line in contents]
    pointsIDS =rs.AddPoints(contents)
    return pointsIDS

if importCSV:
    points = ImportPoints()
# ---------- end python ----------
python_2 = PythonScript(importCSV=Toggle(True))  # -> mesh
# ---------- python_2: Python ----------
# Import points from a text file
import rhinoscriptsyntax as rs


def ImportFaces():
    #prompt the user for a file to import
    filter = "Text file (*.csv)|*.csv|All Files (*.*)|*.*||"
    filename = rs.OpenFileName("Open CSV formatted Faces File", filter)
    if not filename: return
    
    #read each line from the file
    file = open(filename, "r")
    contents = file.readlines()
    file.close()

    # local helper function    
    def from_string(text):
        items = text.strip("()\n")
        F =  str(items)
        return F

    content = [from_string(line) for line in contents]
    return content


if importCSV:
    mesh = ImportFaces()
# ---------- end python_2 ----------
python_3 = PythonScript(importCSV=Toggle(True))  # -> mesh
# ---------- python_3: Python ----------
# Import points from a text file
import rhinoscriptsyntax as rs


def ImportCol():
    #prompt the user for a file to import
    filter = "Text file (*.csv)|*.csv|All Files (*.*)|*.*||"
    filename = rs.OpenFileName("Open CSV formatted Colors File", filter)
    if not filename: return
    
    #read each line from the file
    file = open(filename, "r")
    contents = file.readlines()
    file.close()

    # local helper function    
    def from_string(text):
        items = text.strip("()\n")
        F =  str(items)
        return F

    content = [from_string(line) for line in contents]
    return content


if importCSV:
    mesh = ImportCol()
# ---------- end python_3 ----------

# ---- group: Internalize data (if small amounts of fixed data)
data = Data([Point(-25.44569, 14.318401, 24.552788), Point(-24.642008, 13.790169, 23.131079), Point(-23.744074, 14.481973, 24.552788), Point(-23.018906, 13.971658, 23.131079), Point(-23.744074, 14.481973, 24.552788), Point(-23.018906, 13.971658, 23.131079)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])
data_2 = Data(["Q{0;2;3;1}", "Q{4;6;7;5}", "Q{8;10;11;9}", "Q{12;14;15;13}", "Q{16;18;19;17}", "Q{20;22;23;21}"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])
data_3 = Data(["212,160,132", "213,163,127", "176,88,228", "178,90,227", "176,88,228", "178,90,227"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])

# ----
conmesh = ConstructMesh(Vertices=data, Faces=data_2, Colours=data_3)
conmesh_2 = ConstructMesh(Vertices=python, Faces=python_2, Colours=python_3)
